# Grasshopper definition 250123_UI Connector.ghx (Grasshopper 1.0.8)
# plug-ins: RhinoCodePluginGH

number_slider = Slider(3, range=1..6)
merge = Merge(Data1=number_slider, Data2=Slider(1, range=1..6))
merge_2 = Merge(Data1=Slider(1, range=1..6), Data2=Slider(1, range=1..6))
merge_3 = Merge(Data1=Slider(1, range=1..6), Data2=Slider(1, range=1..6))
merge_4 = Merge(Data1=Slider(1, range=1..6), Data2=Slider(6, range=1..6))
entwine = Entwine(Branch00=merge, Branch01=merge_2, Branch02=merge_3, Branch03=merge_4, FlattenInputs=True)
match = MatchTree(Tree=entwine)
py3 = Python3Script(text_tree=match)  # -> out, simplify(a); inputs text_tree: tree of String
# ---------- py3: Python ----------
import Rhino.Geometry as rg
from Grasshopper import DataTree
from System import Object


group = DataTree[Object]()

for i in range(text_tree.BranchCount):
    path = text_tree.Path(i)
    branch_list = text_tree.Branch(i)
    combined = tuple(branch_list)
    group.Add(combined, path)

a = group

''' group = DataTree[Object]()
final_tree = DataTree[Object]()

for i in range(text_tree.BranchCount):
    path = text_tree.Path(i)
    branch_list = text_tree.Branch(i)
    combined = tuple(branch_list)
    group.Add(combined, path)

for i in range(src_tree.BranchCount):
    path = src_tree.Path(i)
    value = group.Branch(i)
    final_tree.Add(value, path)

a = final_tree '''
# ---------- end py3 ----------
long = LongestList(ListB=py3.a, PaddingMode=2)  # -> ListA, graft(ListB)
py3_2 = Python3Script(text_tree=long.ListB)  # -> out, a; inputs text_tree: tree
# ---------- py3_2: Python ----------
import Rhino.Geometry as rg
from Grasshopper import DataTree
from System import Object


group = DataTree[Object]()
for i in range(text_tree.BranchCount):
    path = text_tree.Path(i)
    tuple_data = text_tree.Branch(i)
    #print(len(tuple_data))  # Assuming each path contains a single tuple
    if tuple_data:
        # Iterate through each element in the tuple and add it to the group at the specified path
        for tup in tuple_data:
            for t in tup:
                group.Add(t, path)
    else:
        group.Add(None, path)

a = group
# ---------- end py3_2 ----------

# ---- group: Set slider properties based on number of columns
panel = Panel("""A+B
myA+B""")
panel_2 = Panel("""60
8
2
10""")
panel_3 = Panel("""0
0
1
0""")
c_script = CSharpScript(reset=Toggle(True), componentName=panel, complusoryName="Wallacei X", max=panel_2, min=panel_3, n=number_slider)  # -> out, A; inputs reset: Boolean, componentName: list of String, complusoryName: list of String, max: list of Int32, min: list of Int32, n: Int32; disabled
# ---------- c_script: C# ----------
    {
      if(reset)
      {
        _n = n;
        _componentName = componentName;
        _complusoryName = complusoryName;
        _max = max;
        _min = min;

        GrasshopperDocument.ScheduleSolution(5, SolutionCallback);

      }
    }
# ---------- c_script: C# additional code ----------
  private int _n;
  private List<int> _max;
  private List<int> _min;
  private List<string> _componentName;
  private List<string> _complusoryName;
  private void SolutionCallback(GH_Document doc)
  {
    int j = 0;
    foreach(string tempStr in _componentName)
    {

      int maxVal = _max[j];
      int minVal = _min[j];

      //search for component in the whole canvas
      foreach(IGH_DocumentObject obj in GrasshopperDocument.Objects)
      {
        if(tempStr == obj.NickName)
        {
          IGH_Component targetComponent = obj as IGH_Component;
          Random rnd = new Random();
          if(targetComponent.Params.Input[1].SourceCount > 0)
          {
            List<IGH_Param> sources = new List<IGH_Param>(targetComponent.Params.Input[1].Sources);
            GrasshopperDocument.RemoveObjects(sources, false);
          }
          for(int i = 0;i < _n;i++)
          {
            //instantiate  new slider
            Grasshopper.Kernel.Special.GH_NumberSlider slid = new Grasshopper.Kernel.Special.GH_NumberSlider();
            slid.CreateAttributes(); //sets up default values, and makes sure your slider doesn't crash rhino

            //customise slider (position, ranges etc)
            int inputcount = targetComponent.Params.Input[1].SourceCount;
            slid.Attributes.Pivot = new System.Drawing.PointF((float) targetComponent.Attributes.DocObject.Attributes.Bounds.Left - slid.Attributes.Bounds.Width - 30, (float) targetComponent.Params.Input[1].Attributes.Bounds.Y + inputcount * 30);
            slid.Slider.Maximum = maxVal;
            slid.Slider.Minimum = minVal;
            slid.Slider.DecimalPlaces = 0;
            slid.SetSliderValue((decimal) rnd.Next(minVal,maxVal));

            //Until now, the slider is a hypothetical object.
            // This command makes it 'real' and adds it to the canvas.
            GrasshopperDocument.AddObject(slid, false);

            //Connect the new slider to this component
            targetComponent.Params.Input[1].AddSource(slid);

            //Connect slider to optimization components
            foreach(string tempStr1 in _complusoryName)
            {
              foreach(IGH_DocumentObject obj1 in GrasshopperDocument.Objects)
              {
                if(tempStr1 == obj1.NickName)
                {
                  IGH_Component targetComponent1 = obj1 as IGH_Component;
                  targetComponent1.Params.Input[0].AddSource(slid);
                }

              }

            }
          }
          j++;
          break;



        }
      }
    }
  }
# ---------- end c_script ----------

# ----
wwww = Wwww([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])
floor = Floor()
extra = Extra()
conc = Conc()
stone = Stone()
conc_thickness = Slider(200, range=0..10000)
stone_thickness = Slider(0.45, range=0..10000)
floor_thickness = Slider(0.1, range=0..10000)
extra_thickness = Slider(0.001, range=0..10000)
wwww_thickness = Slider(50, range=0..10000)
srf = Surface([<surface referenced from the Rhino model> x18])
py3_3 = Python3Script(S=srf)  # -> out, a; inputs S: Surface
# ---------- py3_3: Python ----------
import Rhino.Geometry as rg
from Grasshopper.Kernel.Parameters import Param_Geometry, Param_Brep
from Grasshopper.Kernel.Special import GH_NumberSlider
from Grasshopper.Kernel.Data import GH_Path
from Grasshopper.Kernel.Types import GH_Brep
import Grasshopper  
import scriptcontext as sc
from System.Drawing import PointF
from System import Decimal


a = S.ToBrep()
# ---------- end py3_3 ----------

# ---- group: connector
connector = Python3Script(get_inputs=Toggle(True))  # -> out, a
# ---------- connector: Python ----------
import System.IO as sysIO
import sys
import Grasshopper
import importlib
import scriptcontext as sc
from Grasshopper.Kernel.Data import GH_Path
from Grasshopper import DataTree
from System import Object

# GH path
ghFilePath = Grasshopper.Instances.ActiveDocument.FilePath
ghDirPath = sysIO.Directory.GetParent(ghFilePath)
ghDirPathStr = ghDirPath.ToString()
# Access to ALL python files in the GH file directory as modules
sys.path.append((ghDirPathStr))

import connector
importlib.reload(connector)

if get_inputs:
    myParentDir = ghDirPath.Parent.FullName
    htmlPath = sysIO.Path.Join(myParentDir, "UI\\index.html")

    # Prepare references to the GH doc and component
    gh_doc = Grasshopper.Instances.ActiveCanvas.Document
    thisComp = ghenv.Component

    #myComp = connector.MyComponent()
    result = connector.MyComponent.RunScript(gh_doc, thisComp, get_inputs, htmlPath)
# ---------- end connector ----------

# ----
py3_4 = Python3Script()  # -> out, a, b, c
# ---------- py3_4: Python ----------
import System
import Rhino
import Grasshopper
import Eto.Forms as forms
import Eto.Drawing as drawing
import scriptcontext as sc
import json
import urllib.parse  # Import to handle URL encoding

from Grasshopper.Kernel.Data import GH_Path
from Grasshopper import DataTree
from System import Object


EFM = sc.sticky.get("EFM", {})
element_names = DataTree[Object]()
element_geo = DataTree[Object]()
element_thik = DataTree[Object]()
if "GeomDict" in EFM and "Elements" in EFM["GeomDict"]:
    for i, element in enumerate(EFM["GeomDict"]["Elements"]): 
        path = GH_Path(i)
        element_names.Add(element["name"], path)
        element_thik.Add(element["thickness"], path)
        for geo in element["geometries"]:
            element_geo.Add(geo, path)


a = element_names
b = element_thik
c = element_geo
# ---------- end py3_4 ----------
panel_4 = Panel(connector.a)
panel_5 = Panel(py3_4.a)
panel_6 = Panel(py3_4.b)
panel_7 = Panel(py3_4.c)
S = Script()  # -> out, a; disabled
# ---------- S: Python ----------
import System.IO as sysIO
import sys
import Grasshopper
import importlib
import scriptcontext as sc
from Grasshopper.Kernel.Data import GH_Path
from Grasshopper import DataTree
from System import Object



doc = Grasshopper.Instances.ActiveCanvas.Document

gh_obj = Grasshopper.Kernel.Special.GH_GeometryPipeline()
#gh_container = Grasshopper.Kernel.Parameters.Param_Geometry()

gh_slider = Grasshopper.Kernel.Special.GH_NumberSlider()


doc.AddObject(gh_slider, False)
a = gh_obj
# ---------- end S ----------
panel_8 = Panel(S.a)  # disabled
sender = Python3Script(write=Toggle(True))  # -> out, a
# ---------- sender: Python ----------
import System.IO as sysIO
import sys
import Grasshopper
import importlib
import scriptcontext as sc
from Grasshopper.Kernel.Data import GH_Path
from Grasshopper import DataTree
from System import Object

# GH path
ghFilePath = Grasshopper.Instances.ActiveDocument.FilePath
ghDirPath = sysIO.Directory.GetParent(ghFilePath)
ghDirPathStr = ghDirPath.ToString()
# Access to ALL python files in the GH file directory as modules
sys.path.append((ghDirPathStr))

import connector
importlib.reload(connector)

import sender
importlib.reload(sender)

if write:
    # Prepare references to the GH doc and component
    gh_doc = Grasshopper.Instances.ActiveCanvas.Document
    thisComp = ghenv.Component
    result = sender.MyComponent.RunScript(gh_doc, thisComp)
# ---------- end sender ----------
panel_9 = Panel(sender.a)
