# Grasshopper definition test.gh (Grasshopper 1.0.8)
# plug-ins: Karamba3D, ScriptParasite

X = UnitX(Factor=1)
line = LineSDL(Start="0,1,0", Direction=X, Length=Slider(3, range=1..5))
lineelem = CreateLinearElementKaramba3D(
    Line=line,
    LimitDistance_m=0.005,
    BucklingLengthY_m=-1,
    BucklingLengthZ_m=-1,
    BucklingLengthLT_m=-1,
    Bending=True,
    ToPolylineMaxAngle=0.25,
    ToPolylineTolerance=0.1,
    ToPolylineMaxEdgeLength=0.25,
    New=True,
    Remove=True,
    mode="LineToBeam")  # -> Element, Points, Info
assemble = AssembleModelKaramba3D(Elem=lineelem.Element, LimitDistance_m=0.005)  # -> Model, Info, Mass_kg, CentreOfGravity, LoadCaseNames
panel = Panel("K:\2019\F-19-02_Ferney-Voltaire_Logements_Perraudin\3_AUTRES\B+G_Paramétrisation portiques équivalents\Modèle Rhino+GH\250122\Scripts\karamaba")

c_script = CSharpScript(
    Model_in=assemble.Model,
    Reference=["C:\Program Files\Rhino 8\Plug-ins\Karamba\karamba.gha", "C:\Program Files\Rhino 8\Plug-ins\Karamba\karambaCommon.dll"])  # -> out, A
# ---------- c_script: C# usings ----------
using System.Threading;
using System.Threading.Tasks;
using System.Linq;
using Karamba.Models;
using KarambaCommon;
# ---------- c_script: C# ----------
    Toolkit k3d = new Toolkit();  
    var model = Model_in as Model;
    var elem = model.elems[0];
    A = elem;
# ---------- end c_script ----------
scriptpar = ScriptParasite(Enable=Toggle(True), Folder=panel)

panel_2 = Panel(c_script.A)
